# Grasshopper definition 03_collision_rrt.ghx (Grasshopper 1.0.8)
# plug-ins: Motus
# Collision-aware RRT: ColSphere -> ColScene -> Plan.Collision with joint goal. Click Plan, then drag Motus Scrub or Play.

ur10e = MotusUR10eRobotiq()
joints = MotusJointState(Joints=[1.2, -1, 1.2, -1.6, -1.5708, 0])
colsph = MotusCollisionSphere(Center=[0.35, 0.15, 0.35], Radius=0.12, Name="sphere")
colscene = MotusCollisionScene(Objects=colsph)  # -> Scene, Groups, EndEffectors
scrub = Slider(0, range=0..1)
plan = MotusPlan(Robot=ur10e, Goal=joints, Step=0.005, Collision=colscene.Scene)  # -> Trajectory, Status, Warnings
preview = MotusPreview(Trajectory=plan.Trajectory, ShowStart=False, Position=scrub)  # -> Meshes, Links, TCPPath, State, Time, Index, Invalid
